# Grasshopper definition grasshopper commands (random).gh (Grasshopper 1.0.7)
# plug-ins: Bifocals

arc = Arc(Plane=PlaneXY(0, 0, 0), Radius=Slider(59.04, range=0..100), Angle=Domain(0, 3.141592654))  # -> Arc, Length
construct_domain = ConstructDomain(DomainStart=Slider(2.5, range=0..10), DomainEnd=Slider(10, range=0..10))
random = Random(Range=construct_domain, Number=Slider(20, range=0..100), Seed=Slider(10, range=0..10))
